# Grasshopper definition taichung.gh (Grasshopper 0.9.76)

_1f_crv = Curve([<curve referenced from the Rhino model> x9])
_2f_crv = Curve([<curve referenced from the Rhino model> x9])
_3f_crv = Curve([<curve referenced from the Rhino model> x8])
_1f_srf = Surface(<surface referenced from the Rhino model>)
_2f_srf = Surface(<surface referenced from the Rhino model>)
_3f_srf = Surface(<surface referenced from the Rhino model>)
bcx = BrepCurve(Brep=_1f_srf, Curve=_1f_crv)  # -> flatten(Curves), Points
bcx_2 = BrepCurve(Brep=_2f_srf, Curve=_2f_crv)  # -> flatten(Curves), Points
bcx_3 = BrepCurve(Brep=_3f_srf, Curve=_3f_crv)  # -> Curves, Points
srfsplit = SurfaceSplit(Surface=_3f_srf, Curves=flatten(bcx_3.Curves))
srfsplit_2 = SurfaceSplit(Surface=_1f_srf, Curves=bcx.Curves)
srfsplit_3 = SurfaceSplit(Surface=_2f_srf, Curves=bcx_2.Curves)
cull_i = CullIndex(List=srfsplit_3, Indices=6, Wrap=True)  # -> flatten(List)
cull_i_2 = CullIndex(List=srfsplit, Indices=[0, 1, 4, 7], Wrap=True)  # -> flatten(List)
item = ListItem(List=srfsplit_2, Index=0, Wrap=True)
item_2 = ListItem(List=srfsplit_3, Index=6, Wrap=True)
item_3 = ListItem(List=srfsplit, Index=0, Wrap=True)
edges = BrepEdges(Brep=item)  # -> Naked, Interior, NonManifold
Z = UnitZ(Factor=1)
move = Move(Geometry=item, Motion=Z)  # -> Geometry, Transform
explode = Explode(Curve=edges.Naked, Recursive=True)  # -> Segments, flatten(Vertices)
item_4 = ListItem(List=flatten(explode.Segments), Index=[1, 2, 3, 4, 5, 6, 7, 8, 9], Wrap=True)
item_5 = ListItem(Index=Slider(5, range=0..20), Wrap=True)  # disabled
item_6 = ListItem(Index=Slider(0, range=0..18), Wrap=True)
item_7 = ListItem(Index=Slider(13, range=0..18), Wrap=True)
sort = SortList()  # -> Keys, ValuesA
sort_2 = SortList()  # -> Keys, ValuesA
sort_3 = SortList()  # -> Keys, ValuesA
swp1 = Sweep1(Miter=1)

move_2 = Move(Motion=Vector(0, 0, 10))  # -> Geometry, Transform
division = Division(B=2)
bcx_4 = BrepCurve()  # -> Curves, Points
move_3 = Move(Motion=Vector(0, 0, 10))  # -> Geometry, Transform
Z_2 = UnitZ(Factor=division)
join = JoinCurves(Curves=bcx_4.Curves, Preserve=False)  # -> flatten(Curves)
cull_i_3 = CullIndex(List=join, Indices=[3, 12], Wrap=True)
move_4 = Move(Motion=Z_2)  # -> flatten(Geometry), Transform
sort_4 = SortList(Keys=[0, 1, 2, 3, 4, 5, 6, 7, 9, 8, 10, 11, 12, 13], ValuesA=cull_i_3)  # -> Keys, flatten(ValuesA)
srfsplit_4 = SurfaceSplit(Curves=bcx_4.Curves)
item_8 = ListItem(List=sort_4.ValuesA, Index=[0, 1, 2, 3, 4, 5, 6, 7, 8, 12, 13], Wrap=True)
item_9 = ListItem(List=sort_4.ValuesA, Index=[9, 10, 11], Wrap=True)
flip = FlipCurve(Curve=item_9)  # -> Curve, Flag
item_10 = ListItem(List=srfsplit_4, Index=5, Wrap=True)
merge = Merge(Data1=item_8, Data2=flip.Curve)
ins = InsertItems(List=graft(move_4.Geometry), Indices=3, Wrap=True)
sort_5 = SortList(Keys=[0, 1, 2, 3, 4, 5, 6, 7, 8, 12, 13, 9, 10, 11], ValuesA=merge)  # -> Keys, ValuesA
ins_2 = InsertItems(List=ins, Item=graft(sort_5.ValuesA), Indices=3, Wrap=True)
ins_3 = InsertItems(Wrap=True)
loft = Loft(Curves=ins_2, Options={Adjust=False, Closed=False, LoftEnds=0, LoftSimp=0, LoftType=1, Rebuild=10, Refit=0.01})  # -> flatten(Loft)
ins_4 = InsertItems(Wrap=True)
loft_2 = Loft(Options={Adjust=False, Closed=False, LoftEnds=0, LoftSimp=0, LoftType=0, Rebuild=10, Refit=0.01})
panel = Panel(ins_2)

# ---- group: facade_F2-F3_1_vertex
edges_2 = BrepEdges(Brep=item_2)  # -> flatten(Naked), Interior, NonManifold
edges_3 = BrepEdges(Brep=item_3)  # -> flatten(Naked), Interior, NonManifold
debrep = DeconstructBrep(Brep=cull_i)  # -> Faces, Edges, Vertices
debrep_2 = DeconstructBrep(Brep=cull_i_2)  # -> Faces, Edges, Vertices
c_edge_vertex = C_edge_vertex_2(L=srfsplit_3)  # -> flatten(V)
explode_2 = Explode(Curve=edges_2.Naked, Recursive=True)  # -> Segments, flatten(Vertices)
c_midpoints = C_midpoints(L=debrep.Vertices)
explode_3 = Explode(Curve=edges_3.Naked, Recursive=True)  # -> Segments, flatten(Vertices)
c_midpoints_2 = C_midpoints(L=debrep_2.Vertices)
c_edge_vertex_2 = C_edge_vertex(L=srfsplit)  # -> flatten(R)
end = EndPoints(Curve=c_midpoints)  # -> Start, flatten(End)
end_2 = EndPoints(Curve=c_midpoints_2)  # -> Start, flatten(End)
item_11 = ListItem(List=c_edge_vertex, Index=0, Wrap=True)
cull_i_4 = CullIndex(List=end.End, Indices=0, Wrap=True)  # -> flatten(List)
dom = ConstructDomain(DomainStart="2", DomainEnd="17")
merge_2 = Merge(Data1=end_2.End, Data2=c_edge_vertex_2)
merge_3 = Merge(Data1=cull_i_4, Data2=item_11)
_2f_subset = SubList(List=flatten(explode_3.Vertices), Domain=dom, Wrap=True)  # -> List, Index
sort_6 = SortList(Keys=[2, 3, 5, 6, 0, 1, 4, 7], ValuesA=merge_2)  # -> Keys, ValuesA
sort_7 = SortList(Keys=[1, 3, 4, 5, 6, 7, 8, 0, 2], ValuesA=merge_3)  # -> Keys, ValuesA
devec = DeconstructVector(Vector=merge_3)  # -> XComponent, YComponent, ZComponent
devec_2 = DeconstructVector(Vector=merge_2)  # -> XComponent, YComponent, ZComponent
scale = Scale(Geometry=graft(bcx_2.Curves), Center=graft(sort_7.ValuesA), Factor="0.65")  # -> simplify(Geometry), Transform
scale_2 = Scale(Geometry=graft(bcx_2.Curves), Center=graft(sort_7.ValuesA), Factor="0.55")  # -> simplify(Geometry), Transform
end_3 = EndPoints(Curve=scale.Geometry)  # -> Start, End
end_4 = EndPoints(Curve=scale_2.Geometry)  # -> Start, End
item_12 = ListItem(List=devec.ZComponent, Index=0, Wrap=True)
item_13 = ListItem(List=devec_2.ZComponent, Index=0, Wrap=True)
subtraction = Subtraction(A=item_12, B=item_13)
abs = Absolute(Value=subtraction)
division_2 = Division(A=abs, B="3")

# ----
points = PointList(Points=sort_6.ValuesA, Size=7)
item_14 = ListItem(List=sort_6.ValuesA, Index=6, Wrap=True)
points_2 = PointList(Points=item_14, Size=5)
item_15 = ListItem(List=flatten(end_4.End), Index=2, Wrap=True)
item_16 = ListItem(List=flatten(end_3.End), Index=2, Wrap=True)
devec_3 = DeconstructVector(Vector=merge_3)  # -> XComponent, YComponent, ZComponent
pt2vec = Pt2Vec(V=item_15, V_2=item_14)
pt2vec_2 = Pt2Vec(V=item_16, V_2=item_14)

# ---- group: vertex
scale_3 = Scale(Geometry=graft(bcx_3.Curves), Center=graft(sort_6.ValuesA), Factor="1.3")  # -> simplify(Geometry), Transform
scale_4 = Scale(Geometry=graft(bcx_3.Curves), Center=graft(sort_6.ValuesA), Factor="1.8")  # -> simplify(Geometry), Transform
scale_5 = Scale(Geometry=graft(bcx_3.Curves), Center=graft(sort_6.ValuesA), Factor="0.95")  # -> simplify(Geometry), Transform
end_5 = EndPoints(Curve=scale_3.Geometry)  # -> Start, End
end_6 = EndPoints(Curve=scale_5.Geometry)  # -> Start, End
end_7 = EndPoints(Curve=scale_4.Geometry)  # -> Start, End

# ----
cull_i_5 = CullIndex(List=flatten(end_3.End), Indices="2", Wrap=True)
cull_i_6 = CullIndex(List=flatten(end_4.End), Indices="2", Wrap=True)
move_5 = Move(Geometry=item_16, Motion=pt2vec_2)  # -> Geometry, Transform
move_6 = Move(Geometry=item_15, Motion=pt2vec)  # -> Geometry, Transform
ins_5 = InsertItems(List=cull_i_6, Item=move_6.Geometry, Indices=2, Wrap=True)  # -> graft(List)
ins_6 = InsertItems(List=cull_i_5, Item=move_5.Geometry, Indices=2, Wrap=True)  # -> graft(List)

# ---- group: facade_F2-F3_1_vertex (continued)
merge_4 = Merge(Data1=end_3.Start, Data2=simplify(ins_6))
merge_5 = Merge(Data1=end_4.Start, Data2=simplify(ins_5))

# ---- group: point_align
item_17 = ListItem(List=flatten(end_5.Start), Index="6", Wrap=True)
item_18 = ListItem(List=flatten(end_5.End), Index="7", Wrap=True)
flatten = FlattenTree(Tree=end_5.Start, Path="{0}")
vec2pt = Vector2Pt(PointA=item_17, PointB=item_18, Unitize=False)  # -> Vector, Length
sort_8 = SortList(Keys=[6, 5, 4, 3, 2, 1, 0, 7], ValuesA=flatten)  # -> Keys, ValuesA
division_3 = Division(A=vec2pt.Vector, B="2")
move_7 = Move(Geometry=item_17, Motion=division_3)  # -> Geometry, Transform
cull_i_7 = CullIndex(List=sort_8.ValuesA, Indices=0, Wrap=True)
ins_7 = InsertItems(List=cull_i_7, Item=move_7.Geometry, Indices=0, Wrap=True)
points_3 = PointList(Points=ins_7, Size=5)

# ---- group: 1F_vertex
dom_2 = ConstructDomain(DomainStart="2", DomainEnd="19")
dom_3 = ConstructDomain(DomainStart="6", DomainEnd="23")
_1f_subset = SubList(List=flatten(explode.Vertices), Domain=dom_2, Wrap=True)  # -> List, Index
_2f_subset_2 = SubList(List=flatten(explode_2.Vertices), Domain=dom_3, Wrap=True)  # -> List, Index
sort_9 = SortList(Keys=[4, 7, 3, 5, 6, 9, 8, 11, 10, 13, 12, 14, 15, 16, 1, 2, 17, 0], ValuesA=_1f_subset.List)  # -> Keys, ValuesA

pdecon = Deconstruct(Point=_1f_subset.List)  # -> XComponent, YComponent, flatten(ZComponent)
pdecon_2 = Deconstruct(Point=_2f_subset_2.List)  # -> XComponent, YComponent, flatten(ZComponent)
item_19 = ListItem(List=pdecon.ZComponent, Index=0, Wrap=True)
item_20 = ListItem(List=pdecon_2.ZComponent, Index=0, Wrap=True)
subtraction_2 = Subtraction(A=item_20, B=item_19)
Z_3 = UnitZ(Factor=subtraction_2)

move_8 = Move(Geometry=sort_9.ValuesA, Motion=Z_3)  # -> Geometry, Transform

# ---- group: point_align
Z_4 = UnitZ(Factor=expr("x*3", division_2))
Z_5 = UnitZ(Factor=expr("x*2", division_2))
Z_6 = UnitZ(Factor=division_2)
_2f_pt = Point(_2f_subset_2.List)
lng = ListLength(List=_2f_pt)
move_9 = Move(Geometry=merge_4, Motion=Z_6)  # -> Geometry, Transform
move_10 = Move(Geometry=merge_5, Motion=Z_6)  # -> Geometry, Transform
move_11 = Move(Geometry=merge_4, Motion=Z_4)  # -> Geometry, Transform
move_12 = Move(Geometry=merge_5, Motion=Z_5)  # -> Geometry, Transform
dom_4 = ConstructDomain(DomainStart=0, DomainEnd=lng)
range = Range(Domain=dom_4, Steps=expr("x/2", lng))
cluster = Cluster_3(L=range)
item_21 = ListItem(List=_2f_pt, Index=cluster, Wrap=True)
cull_i_8 = CullIndex(List=item_21, Indices=[0, 7], Wrap=True)  # -> flatten(List)
points_4 = PointList(Points=cull_i_8, Size=5)

# ----
points_5 = PointList(Points=move_8.Geometry, Size=5)
points_6 = PointList(Points=sort_9.ValuesA, Size=5)
points_7 = PointList(Points=_2f_subset_2.List, Size=5)

# ---- group: point_align
cluster_2 = Cluster(L=merge_4)
cluster_3 = Cluster(L=move_10.Geometry)
cluster_4 = Cluster_2(L=move_11.Geometry)
cluster_5 = Cluster_2(L=move_12.Geometry)
shift = ShiftList(List=cluster_2, Shift="1", Wrap=True)
shift_2 = ShiftList(List=cluster_3, Shift="1", Wrap=True)
shift_3 = ShiftList(List=cluster_4, Shift="1", Wrap=True)
shift_4 = ShiftList(List=cluster_5, Shift="1", Wrap=True)
cull_i_9 = CullIndex(List=shift, Indices=8, Wrap=True)  # -> flatten(List)
cull_i_10 = CullIndex(List=shift_2, Indices=8, Wrap=True)  # -> flatten(List)
cull_i_11 = CullIndex(List=shift_3, Indices=8, Wrap=True)  # -> flatten(List)
cull_i_12 = CullIndex(List=shift_4, Indices=8, Wrap=True)  # -> flatten(List)
points_8 = PointList(Points=cull_i_9, Size=5)
points_9 = PointList(Points=cull_i_10, Size=5)
points_10 = PointList(Points=cull_i_11, Size=5)
points_11 = PointList(Points=cull_i_12, Size=5)

# ----
cull_i_13 = CullIndex(List=flatten(end_5.End), Indices="7", Wrap=True)
item_22 = ListItem(List=flatten(end_5.Start), Index=6, Wrap=True)
ins_8 = InsertItems(List=cull_i_13, Item=item_22, Indices=0, Wrap=True)
ins_9 = InsertItems(List=ins_8, Item=move_7.Geometry, Indices=0, Wrap=True)
points_12 = PointList(Points=ins_8, Size=5)
panel_2 = Panel("""0
2
3
1
8
7
6
5
4""")
panel_3 = Panel("""1
3
5
7
9
11
13
14
16""")
panel_4 = Panel("""0
2
4
5
6
7
8
1
3""")
item_23 = ListItem(List=_2f_pt, Index=panel_3, Wrap=True)
sort_10 = SortList(Keys=panel_2, ValuesA=ins_9)  # -> Keys, ValuesA
points_13 = PointList(Points=ins_9, Size=5)
split = SplitList(List=flatten(merge_4), Index=14)  # -> ListA, ListB
item_24 = ListItem(List=flatten(_2f_pt), Index=0, Wrap=True)
sort_11 = SortList(Keys=panel_4, ValuesA=item_23)  # -> Keys, ValuesA
cluster_6 = Cluster_4(L=move_9.Geometry)  # -> i, i_2
cluster_7 = Cluster_5(L=move_11.Geometry)  # -> i, i_2
cluster_8 = Cluster_4(L=move_12.Geometry)  # -> i, i_2
points_14 = PointList(Points=sort_10.ValuesA, Size=5)
path_mapper = PathMapper(split.ListA, source="{A;B}(i)", target="{A;B;floor(i/2)}(i%2)")
path_mapper_2 = PathMapper(split.ListB, source="{A;B}(i)", target="{A;B;floor(i/2)}(i%2)")
points_15 = PointList(Points=sort_11.ValuesA, Size=5)
points_16 = PointList(Points=item_24, Size=5)
merge_6 = Merge(Data1=sort_11.ValuesA, Data2=item_24)  # -> flatten(Result)
item_25 = ListItem(List=flatten(move_11.Geometry), Index=0, Wrap=True)
item_26 = ListItem(List=flatten(move_12.Geometry), Index=0, Wrap=True)
item_27 = ListItem(List=flatten(cluster_3), Index=0, Wrap=True)
item_28 = ListItem(List=flatten(merge_4), Index=0, Wrap=True)
item_29 = ListItem(List=path_mapper, Index=1, Wrap=True)
item_30 = ListItem(List=path_mapper_2, Index=0, Wrap=True)
item_31 = ListItem(List=flatten(end_5.End), Index=7, Wrap=True)
points_17 = PointList(Points=item_25, Size=5)
points_18 = PointList(Points=item_27, Size=5)
points_19 = PointList(Points=item_26, Size=5)
points_20 = PointList(Points=item_28, Size=5)
merge_7 = Merge(Data1=item_29, Data2=item_30, Data3=item_28)  # -> flatten(Result)
merge_8 = Merge(Data1=cluster_6.i, Data2=cluster_6.i_2, Data3=item_27)  # -> flatten(Result)
merge_9 = Merge(Data1=sort_10.ValuesA, Data2=item_31)  # -> flatten(Result)
merge_10 = Merge(Data1=cluster_7.i, Data2=cluster_7.i_2, Data3=item_25)  # -> flatten(Result)
merge_11 = Merge(Data1=cluster_8.i, Data2=cluster_8.i_2, Data3=item_26)  # -> flatten(Result)
points_21 = PointList(Points=item_31, Size=5)
points_22 = PointList(Points=merge_7, Size=5)
points_23 = PointList(Points=merge_8, Size=5)
points_24 = PointList(Points=merge_10, Size=5)
points_25 = PointList(Points=merge_11, Size=5)
points_26 = PointList(Points=merge_6, Size=5)
points_27 = PointList(Points=merge_9, Size=5)

# ---- group: facade_F2-F3_2
insert = Insert(L=merge_6, I=merge_7, I_2=merge_8, I_3=merge_11, I_4=merge_10, I_5=merge_9)
nurbs = NurbsCurve(Vertices=insert, Degree=5, Periodic=False)  # -> simplify(Curve), Length, Domain

# ---- group: facade_F1
insert_2 = Insert_2(I_2=sort_9.ValuesA, L=move_8.Geometry, I=_2f_subset_2.List)
nurbs_2 = NurbsCurve(Vertices=insert_2, Degree=2, Periodic=False)  # -> Curve, Length, Domain

# ---- group: facade_F2-F3_1
insert_3 = Insert(L=ins_7, I=cull_i_11, I_2=cull_i_12, I_3=cull_i_10, I_4=cull_i_9, I_5=cull_i_8)
nurbs_3 = NurbsCurve(Vertices=insert_3, Degree=5, Periodic=False)  # -> simplify(Curve), Length, Domain

# ----
merge_12 = Merge(Data1=flatten(nurbs_3.Curve), Data2=flatten(nurbs.Curve))

# ==== cluster C_midpoints
L = ClusterInput()
item = ListItem(List=L, Index="1", Wrap=True)
item_2 = ListItem(List=L, Index="0", Wrap=True)
panel = Panel(L)
ln = Line(StartPoint=item_2, EndPoint=item)
len = Length(Curve=ln)
division = Division(A=len, B=2)
line_sdl = LineSDL(Start=item_2, Direction=ln, Length=division)
L_2 = ClusterOutput(line_sdl)

# ==== cluster C_edge_vertex
L = ClusterInput()
item = ListItem(List=L, Index=[1, 4, 7], Wrap=True)
debrep = DeconstructBrep(Brep=item)  # -> Faces, Edges, Vertices
devec = DeconstructVector(Vector=debrep.Vertices)  # -> XComponent, YComponent, ZComponent
Y = UnitY(Factor=devec.YComponent)
X = UnitX(Factor=devec.XComponent)
line_sdl = LineSDL(Start=debrep.Vertices, Direction=Y, Length=1)
line_sdl_2 = LineSDL(Start=debrep.Vertices, Direction=X, Length=1)
ccx = CurveCurve(CurveA=line_sdl_2, CurveB=line_sdl)  # -> simplify(Points), ParamsA, ParamsB
branch = TreeBranch(Tree=ccx.Points, Path="{0;0}", MaintainPaths=True)
branch_2 = TreeBranch(Tree=ccx.Points, Path="{1;0}", MaintainPaths=True)
branch_3 = TreeBranch(Tree=ccx.Points, Path="{2;0}", MaintainPaths=True)
merge = Merge(Data1=branch, Data2=branch_2, Data3=branch_3)
R = ClusterOutput(merge)

# ==== cluster C_edge_vertex_2
L = ClusterInput()
item = ListItem(List=L, Index=0, Wrap=True)
debrep = DeconstructBrep(Brep=item)  # -> Faces, Edges, Vertices
devec = DeconstructVector(Vector=debrep.Vertices)  # -> XComponent, YComponent, ZComponent
points = PointList(Points=debrep.Vertices, Size=5)
X = UnitX(Factor=devec.XComponent)
Y = UnitY(Factor=devec.YComponent)
line_sdl = LineSDL(Start=debrep.Vertices, Direction=Y, Length=1)
line_sdl_2 = LineSDL(Start=debrep.Vertices, Direction=X, Length=1)
ccx = CurveCurve(CurveA=line_sdl_2, CurveB=line_sdl)  # -> simplify(Points), ParamsA, ParamsB
line = Line(line_sdl_2)
V = ClusterOutput(debrep.Vertices)

# ==== cluster Cluster
L = ClusterInput()
split = SplitList(List=flatten(L), Index="14")  # -> ListA, ListB
panel = Panel(split.ListA)
path_mapper = PathMapper(split.ListB, source="{A;B}(i)", target="{A;B;floor(i/2)}(i%2)")
path_mapper_2 = PathMapper(split.ListA, source="{A;B}(i)", target="{A;B;floor(i/2)}(i%2)")
panel_2 = Panel(path_mapper_2)
item = ListItem(List=path_mapper_2, Index="0", Wrap=True)  # -> flatten(Item)
panel_3 = Panel(item)
item_2 = ListItem(List=path_mapper, Index="1", Wrap=True)  # -> flatten(Item)
merge = Merge(Data1=item, Data2=item_2)
R = ClusterOutput(merge)

# ==== cluster Cluster_2
L = ClusterInput()
split = SplitList(List=flatten(L), Index=14)  # -> ListA, ListB
path_mapper = PathMapper(split.ListB, source="{A;B}(i)", target="{A;B;floor(i/2)}(i%2)")
path_mapper_2 = PathMapper(split.ListA, source="{A;B}(i)", target="{A;B;floor(i/2)}(i%2)")
item = ListItem(List=path_mapper_2, Index=0, Wrap=True)  # -> flatten(Item)
item_2 = ListItem(List=path_mapper, Index=1, Wrap=True)  # -> flatten(Item)
merge = Merge(Data1=item, Data2=item_2)
R = ClusterOutput(merge)

# ==== cluster Cluster_3
L = ClusterInput()
split = SplitList(List=L, Index=8)  # -> ListA, ListB
panel = Panel(L)
addition = Addition(A=split.ListB, B="-1")
merge = Merge(Data1=split.ListA, Data2=addition)  # -> simplify(Result)
panel_2 = Panel(merge)
R = ClusterOutput(merge)

# ==== cluster Insert
L = ClusterInput()
I = ClusterInput()
ins = InsertItems(List=graft(L), Item=graft(I), Indices=2, Wrap=True)
I_2 = ClusterInput()
ins_2 = InsertItems(List=ins, Item=graft(I_2), Indices=3, Wrap=True)
I_3 = ClusterInput()
ins_3 = InsertItems(List=ins_2, Item=graft(I_3), Indices=4, Wrap=True)
I_4 = ClusterInput()
ins_4 = InsertItems(List=ins_3, Item=graft(I_4), Indices=5, Wrap=True)
I_5 = ClusterInput()
ins_5 = InsertItems(List=ins_4, Item=graft(I_5), Indices=6, Wrap=True)
L_2 = ClusterOutput(ins_5)

# ==== cluster Insert_2
L = ClusterInput()
I = ClusterInput()
ins = InsertItems(List=graft(L), Item=graft(I), Indices=3, Wrap=True)
I_2 = ClusterInput()
ins_2 = InsertItems(List=ins, Item=graft(I_2), Indices=3, Wrap=True)
L_2 = ClusterOutput(ins_2)

# ==== cluster Pt2Vec
V = ClusterInput()
V_2 = ClusterInput()
devec = DeconstructVector(Vector=V)  # -> XComponent, YComponent, ZComponent
devec_2 = DeconstructVector(Vector=V_2)  # -> XComponent, YComponent, ZComponent
item = ListItem(List=devec.ZComponent, Index=0, Wrap=True)
item_2 = ListItem(List=devec_2.ZComponent, Index=0, Wrap=True)
subtraction = Subtraction(A=item, B=item_2)
X = UnitX(Factor=expr("x*0.5", subtraction))
V_3 = ClusterOutput(X)

# ==== cluster Cluster_4
L = ClusterInput()
split = SplitList(List=flatten(L), Index=14)  # -> ListA, ListB
path_mapper = PathMapper(split.ListA, source="{A;B}(i)", target="{A;B;floor(i/2)}(i%2)")
path_mapper_2 = PathMapper(split.ListB, source="{A;B}(i)", target="{A;B;floor(i/2)}(i%2)")
item = ListItem(List=path_mapper, Index=1, Wrap=True)
item_2 = ListItem(List=path_mapper_2, Index=0, Wrap=True)
i = ClusterOutput(item)
i_2 = ClusterOutput(item_2)

# ==== cluster Cluster_5
L = ClusterInput()
split = SplitList(List=flatten(L), Index=14)  # -> ListA, ListB
path_mapper = PathMapper(split.ListB, source="{A;B}(i)", target="{A;B;floor(i/2)}(i%2)")
path_mapper_2 = PathMapper(split.ListA, source="{A;B}(i)", target="{A;B;floor(i/2)}(i%2)")
item = ListItem(List=path_mapper_2, Index=1, Wrap=True)
item_2 = ListItem(List=path_mapper, Index=0, Wrap=True)
i = ClusterOutput(item)
i_2 = ClusterOutput(item_2)
